# Grasshopper definition 2D+.gh (Grasshopper 1.0.7)

# ---- group: inputs
number_slider = Slider(30, range=1..100)
number_slider_2 = Slider(26, range=1..100)
curve = Curve([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])

# ---- group: initial division
divide_curve = DivideCurve(Curve=curve, Count=number_slider, Kinks=False)  # -> Points, Tangents, Parameters
point = Point(simplify(divide_curve.Points))
flip_matrix = FlipMatrix(Data=point)
interpolate = Interpolate(Vertices=flip_matrix, Degree=3, Periodic=True, KnotStyle=1)  # -> flatten(Curve), Length, Domain
divide_curve_2 = DivideCurve(Curve=interpolate.Curve, Count=number_slider_2, Kinks=False)  # -> simplify(Points), Tangents, Parameters
flip_matrix_2 = FlipMatrix(Data=divide_curve_2.Points)
interpolate_2 = Interpolate(Vertices=flip_matrix_2, Degree=3, Periodic=False, KnotStyle=1)  # -> flatten(Curve), Length, Domain

# ---- group: finding edges to extrude
construct_domain² = ConstructDomain²(DomainU=Domain(0, 1), DomainV=Domain(0, 1))
divide_domain² = DivideDomain²(Domain=construct_domain², UCount=number_slider, VCount=number_slider_2)
network_surface = NetworkSurface(CurvesU=interpolate.Curve, CurvesV=interpolate_2.Curve, Continuity=2)  # -> reparameterize(Surface)
isotrim = Isotrim(Surface=network_surface, Domain=divide_domain²)
divide_domain²_2 = DivideDomain²(Domain=network_surface, UCount=number_slider, VCount=number_slider_2)
surface = Surface(reparameterize(simplify(isotrim)))
negative = Negative(Value=Slider(7.122, range=0..10))
curve_2 = Curve(isotrim)
surface_box = SurfaceBox(Surface=network_surface, Domain=divide_domain²_2, Height=negative)
explode = Explode(Curve=curve_2, Recursive=True)  # -> Segments, Vertices
deconstruct_brep = DeconstructBrep(Brep=surface_box)  # -> Faces, Edges, Vertices
evaluate_surface = EvaluateSurface(Surface=surface, Point="0.5,0.5")  # -> Point, Normal, UDirection, VDirection, Frame
panel = Panel("""0
-1""")
list_item = ListItem(List=explode.Vertices, Index=0, Wrap=True)  # -> Item, Item1, Item2, Item3
cull_index = CullIndex(List=deconstruct_brep.Faces, Indices=panel, Wrap=True)  # -> flatten(List)

# ---- group: building structure thickness
amplitude = Amplitude(Vector=evaluate_surface.Normal, Amplitude=negative)  # -> simplify(Vector)
line = Line(StartPoint=list_item.Item1, EndPoint=list_item.Item3)  # -> flatten(Line)
extrude = Extrude(Base=line, Direction=amplitude)  # -> flatten(Extrusion)
surface_2 = Surface(reparameterize(cull_index))
evaluate_surface_2 = EvaluateSurface(Surface=surface_2, Point="0.5,0.5")  # -> Point, Normal, UDirection, VDirection, Frame
evaluate_surface_3 = EvaluateSurface(Surface=extrude, Point="0.5,0.5")  # -> Point, Normal, UDirection, VDirection, Frame
number_slider_3 = Slider(0.5, range=0..2)
amplitude_2 = Amplitude(Vector=evaluate_surface_2.Normal, Amplitude=number_slider_3)
amplitude_3 = Amplitude(Vector=evaluate_surface_3.Normal, Amplitude=number_slider_3)
amplitude_4 = Amplitude(Vector=evaluate_surface_3.Normal, Amplitude=number_slider_3)
negative_2 = Negative(Value=amplitude_3)
extrude_2 = Extrude(Base=extrude, Direction=amplitude_4)
extrude_3 = Extrude(Base=extrude, Direction=negative_2)
extrude_4 = Extrude(Base=surface_2, Direction=amplitude_2)
merge = Merge(Data1=extrude_3, Data2=extrude_2)
merge_2 = Merge(Data1=merge, Data2=extrude_4)

# ---- group: building structure thickness / structure
brep = Brep(merge_2)

# ---- group: building screws
curve_3 = Curve(deconstruct_brep.Edges)

# ---- group: building screws / finding intersections
list_item_2 = ListItem(List=curve_3, Index="6", Wrap=True)
curve_4 = Curve(list_item_2)
divide_curve_3 = DivideCurve(Curve=curve_4, Count="2", Kinks=False)  # -> Points, Tangents, Parameters
list_item_3 = ListItem(List=divide_curve_3.Points, Index="1", Wrap=True)

# ---- group: building screws / middle part
scale = Scale(Geometry=curve_4, Center=list_item_3, Factor=Slider(1.2, range=1..2))  # -> Geometry, Transform
end_points = EndPoints(Curve=scale.Geometry)  # -> Start, End
merge_3 = Merge(Data1=end_points.Start, Data2=end_points.End)
circle_cnr = CircleCNR(Center=merge_3, Normal=divide_curve_3.Tangents, Radius=Slider(1, range=1..10))
cull_index_2 = CullIndex(List=circle_cnr, Indices="1", Wrap=True)
loft = Loft(Curves=cull_index_2, Options={Adjust=False, Closed=False, LoftEnds=0, LoftSimp=0, LoftType=0, Rebuild=10, Refit=0.01})

# ---- group: building screws / main part
scale_2 = Scale(Geometry=curve_4, Center=list_item_3, Factor=Slider(1.1, range=1..2))  # -> Geometry, Transform
end_points_2 = EndPoints(Curve=scale_2.Geometry)  # -> Start, End
merge_4 = Merge(Data1=end_points_2.Start, Data2=end_points_2.End)
circle_cnr_2 = CircleCNR(Center=merge_4, Normal=divide_curve_3.Tangents, Radius=Slider(3, range=1..10))
cull_index_3 = CullIndex(List=circle_cnr_2, Indices="1", Wrap=True)
loft_2 = Loft(Curves=cull_index_3, Options={Adjust=False, Closed=False, LoftEnds=0, LoftSimp=0, LoftType=0, Rebuild=10, Refit=0.01})

# ---- group: building screws (continued)
merge_5 = Merge(Data1=loft_2, Data2=loft)
cap_holes = CapHoles(Brep=merge_5)

# ---- group: building screws / screws
brep_2 = Brep(cap_holes)

# ----
merge_6 = Merge(Data1=brep, Data2=brep_2)

# ---- group: preview
brep_3 = Brep(merge_6)
custom_preview = CustomPreview(Geometry=brep_3, Material=ColourSwatch(SwatchColor=RGB(186, 160, 160)))

# ---- group: final geometry
brep_4 = Brep(merge_6)
