# Grasshopper definition 2D.gh (Grasshopper 1.0.7)

# ---- group: input / horizontal division
number_slider = Slider(25, range=1..100)

# ---- group: input / vertical division
number_slider_2 = Slider(30, range=1..100)

# ---- group: input / cleaned outlines from base mesh
curve = Curve([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])

# ---- group: initial division
curve_2 = Curve(curve)
divide_curve = DivideCurve(Curve=curve_2, Count=number_slider, Kinks=False)  # -> Points, Tangents, Parameters
point = Point(simplify(divide_curve.Points))
cull_index = CullIndex(List=point, Indices="0", Wrap=True)
flip_matrix = FlipMatrix(Data=cull_index)
interpolate = Interpolate(Vertices=flip_matrix, Degree=3, Periodic=True, KnotStyle=1)  # -> flatten(Curve), Length, Domain
integer = Integer(number_slider_2)
divide_curve_2 = DivideCurve(Curve=interpolate.Curve, Count=integer, Kinks=False)  # -> simplify(Points), Tangents, Parameters
flip_matrix_2 = FlipMatrix(Data=divide_curve_2.Points)
interpolate_2 = Interpolate(Vertices=flip_matrix_2, Degree=3, Periodic=False, KnotStyle=1)  # -> flatten(Curve), Length, Domain

# ---- group: initial division / Horizontal
curve_3 = Curve(flatten(interpolate.Curve))

# ---- group: initial division / Vertical
curve_4 = Curve(flatten(interpolate_2.Curve))

# ---- group: finding crossing points
curve_5 = Curve(flatten(curve_3))
curve_6 = Curve(flatten(curve_4))
merge = Merge(Data1=curve_5, Data2=curve_6)  # -> flatten(Result)
multiple_curves = MultipleCurves(Curves=merge)  # -> Points, IndexA, IndexB, ParamA, ParamB
point_2 = Point(multiple_curves.Points)
partition_list = PartitionList(List=point_2, Size=number_slider_2)  # -> simplify(Chunks)
point_3 = Point(simplify(partition_list))

# ---- group: building rectangle surfaces
point_4 = Point(simplify(point_3))
point_5 = Point(simplify(point_3))
shift_list = ShiftList(List=point_5, Shift=Slider(1, range=0..3), Wrap=True)
partition_list_2 = PartitionList(List=point_4, Size="2")
partition_list_3 = PartitionList(List=shift_list, Size="2")  # -> simplify(Chunks)
path_mapper = PathMapper(partition_list_3, source="{A;B}", target="{B}")
path_mapper_2 = PathMapper(partition_list_2, source="{A;B}", target="{B}")
panel = Panel("""-4
-3
-2
-1""")
shift_list_2 = ShiftList(List=path_mapper_2, Shift=Slider(2, range=0..3), Wrap=True)
panel_2 = Panel("""-4
-3
-2
-1""")
shift_list_3 = ShiftList(List=path_mapper, Shift=Slider(2, range=0..3), Wrap=True)
partition_list_4 = PartitionList(List=path_mapper, Size="4")
cull_index_2 = CullIndex(List=shift_list_2, Indices=panel_2, Wrap=True)
cull_index_3 = CullIndex(List=shift_list_3, Indices=panel, Wrap=True)
partition_list_5 = PartitionList(List=path_mapper_2, Size="4")
partition_list_6 = PartitionList(List=cull_index_2, Size="4")
partition_list_7 = PartitionList(List=cull_index_3, Size="4")
point_6 = Point(simplify(partition_list_6))
point_7 = Point(partition_list_5)
point_8 = Point(partition_list_7)
point_9 = Point(partition_list_4)
list_item = ListItem(List=point_6, Index=0, Wrap=True)  # -> Item, Item1, Item2, Item3
list_item_2 = ListItem(List=point_7, Index=0, Wrap=True)  # -> Item, Item1, Item2, Item3
list_item_3 = ListItem(List=point_9, Index=0, Wrap=True)  # -> Item, Item1, Item2, Item3
list_item_4 = ListItem(List=point_8, Index=0, Wrap=True)  # -> Item, Item1, Item2, Item3
point_10 = Point(flatten(list_item.Item3))
_4point_surface = _4PointSurface(CornerA=list_item_2.Item, CornerB=list_item_2.Item1, CornerC=list_item_2.Item3, CornerD=list_item_2.Item2)  # -> simplify(Surface)
_4point_surface_2 = _4PointSurface(CornerA=list_item.Item, CornerB=list_item.Item1, CornerC=list_item.Item3, CornerD=list_item.Item2)  # -> simplify(Surface)
_4point_surface_3 = _4PointSurface(CornerA=list_item_3.Item, CornerB=list_item_3.Item1, CornerC=list_item_3.Item3, CornerD=list_item_3.Item2)
_4point_surface_4 = _4PointSurface(CornerA=list_item_4.Item, CornerB=list_item_4.Item1, CornerC=list_item_4.Item3, CornerD=list_item_4.Item2)  # -> simplify(Surface)
merge_2 = Merge(Data1=_4point_surface_3, Data2=_4point_surface_4)  # -> flatten(Result)
merge_3 = Merge(Data1=_4point_surface, Data2=_4point_surface_2)  # -> flatten(Result)
integer_2 = Integer(number_slider)
integer_3 = Integer(number_slider_2)
partition_list_8 = PartitionList(List=merge_2, Size=integer_3)
partition_list_9 = PartitionList(List=merge_3, Size=integer_2)
surface = Surface(partition_list_9)
surface_2 = Surface(partition_list_8)
merge_4 = Merge(Data1=surface, Data2=surface_2)
curve_7 = Curve(merge_4)

# ---- group: building traingle surfaces
curve_8 = Curve(curve_7)
explode = Explode(Curve=curve_8, Recursive=True)  # -> Segments, Vertices
list_item_5 = ListItem(List=explode.Vertices, Index=0, Wrap=True)  # -> Item, Item1, Item2, Item3
list_item_6 = ListItem(List=explode.Vertices, Index=0, Wrap=True)  # -> Item, Item1, Item2
merge_5 = Merge(Data1=list_item_6.Item, Data2=list_item_6.Item1, Data3=list_item_6.Item2)
merge_6 = Merge(Data1=list_item_5.Item, Data2=list_item_5.Item2, Data3=list_item_5.Item3)
polyline = PolyLine(Vertices=merge_6, Closed=True)
polyline_2 = PolyLine(Vertices=merge_5, Closed=True)
surface_3 = Surface(polyline)
surface_4 = Surface(polyline_2)

# ---- group: extruding panels
face_normals = FaceNormals(Mesh=surface_4)  # -> Centers, Normals
radians = Radians(Degrees="180")
area = Area(Geometry=polyline_2)  # -> Area, Centroid
rotate_3d = Rotate3D(Geometry=surface_4, Angle=radians, Center=area.Centroid, Axis=face_normals.Normals)  # -> Geometry, Transform
area_2 = Area(Geometry=rotate_3d.Geometry)  # -> Area, Centroid
scale = Scale(Geometry=rotate_3d.Geometry, Center=area_2.Centroid, Factor=Slider(0.75, range=0.5..1.5))  # -> Geometry, Transform
surface_5 = Surface(reparameterize(simplify(polyline)))
surface_6 = Surface(reparameterize(simplify(scale.Geometry)))
evaluate_surface = EvaluateSurface(Surface=surface_6, Point="0.5,0.5")  # -> Point, Normal, UDirection, VDirection, Frame
evaluate_surface_2 = EvaluateSurface(Surface=surface_5, Point="0.5,0.5")  # -> Point, Normal, UDirection, VDirection, Frame
amplitude = Amplitude(Vector=evaluate_surface_2.Normal, Amplitude=Slider(3.3, range=2..5))
amplitude_2 = Amplitude(Vector=evaluate_surface.Normal, Amplitude=Slider(3, range=2..5))
negative = Negative(Value=amplitude)
extrude = Extrude(Base=surface_6, Direction=amplitude_2)
extrude_2 = Extrude(Base=surface_5, Direction=negative)
merge_7 = Merge(Data1=extrude, Data2=extrude_2)
brep = Brep(merge_7)

# ---- group: preview
brep_2 = Brep(extrude_2)
brep_3 = Brep(extrude)
custom_preview = CustomPreview(Geometry=brep_3, Material=ColourSwatch(SwatchColor=RGB(125, 59, 59)))
custom_preview_2 = CustomPreview(Geometry=brep_2, Material=ColourSwatch(SwatchColor=RGB(186, 160, 160)))

# ---- group: final geometry
brep_4 = Brep(brep)
