# Grasshopper definition 3D+.gh (Grasshopper 1.0.7)
# plug-ins: Weaverbird

curve = Curve([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])

# ---- group: initial division
divide_curve = DivideCurve(Curve=curve, Count=Slider(20, range=1..100), Kinks=False)  # -> Points, Tangents, Parameters
point = Point(simplify(divide_curve.Points))
flip_matrix = FlipMatrix(Data=point)
interpolate = Interpolate(Vertices=flip_matrix, Degree=3, Periodic=True, KnotStyle=1)  # -> flatten(Curve), Length, Domain
divide_curve_2 = DivideCurve(Curve=interpolate.Curve, Count=Slider(10, range=1..100), Kinks=False)  # -> simplify(Points), Tangents, Parameters
flip_matrix_2 = FlipMatrix(Data=divide_curve_2.Points)
interpolate_2 = Interpolate(Vertices=flip_matrix_2, Degree=3, Periodic=False, KnotStyle=1)  # -> flatten(Curve), Length, Domain

# ---- group: creating surface boxes
network_surface = NetworkSurface(CurvesU=interpolate.Curve, CurvesV=interpolate_2.Curve, Continuity=2)
number_slider = Slider(18, range=0..50)
divide = DivideDomain²(Domain=network_surface, UCount=Slider(38, range=0..50), VCount=number_slider)
negative = Negative(Value=Slider(6, range=0..40))
sbox = SurfaceBox(Surface=network_surface, Domain=divide, Height=negative)
sbox_2 = SurfaceBox(Surface=network_surface, Domain=divide, Height=Slider(5, range=0..40))
partition_list = PartitionList(List=sbox, Size=number_slider)  # -> simplify(Chunks)
dispatch = Dispatch(List=partition_list, DispatchPattern=[True, False])  # -> ListA, ListB

# ---- group: applaying components to boxes / component #1 rotated
mesh = Mesh(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)

# ---- group: applaying components to boxes / component #2
mesh_2 = Mesh(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)

# ---- group: applaying components to boxes / component #1
mesh_3 = Mesh(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)

# ---- group: applaying components to boxes
radians = Radians(Degrees="180")
rotate = Rotate(Geometry=mesh, Angle=radians, Plane=PlaneXY(0, 0, 0))  # -> Geometry, Transform
twisted_box = TwistedBox(dispatch.ListA)
twisted_box_2 = TwistedBox(dispatch.ListB)
mesh_4 = Mesh(rotate.Geometry)
mesh_colours = MeshColours(Mesh=mesh_2, Colours=ColourSwatch(SwatchColor=RGB(255, 255, 255)))
mesh_colours_2 = MeshColours(Mesh=mesh_4, Colours=ColourSwatch(SwatchColor=RGB(255, 255, 255)))
mesh_colours_3 = MeshColours(Mesh=mesh_3, Colours=ColourSwatch(SwatchColor=RGB(255, 255, 255)))
mesh_5 = Mesh(mesh_colours_2)
mesh_6 = Mesh(mesh_colours)
mesh_7 = Mesh(mesh_colours_3)
bounding_box = BoundingBox(Content=mesh_6, Plane=PlaneXY(0, 0, 0))  # -> Box, Box_2
bounding_box_2 = BoundingBox(Content=mesh_5, Plane=PlaneXY(0, 0, 0))  # -> Box, Box_2
bounding_box_3 = BoundingBox(Content=mesh_7, Plane=PlaneXY(0, 0, 0))  # -> Box, Box_2
box_morph = BoxMorph(Geometry=mesh_6, Reference=bounding_box.Box, Target=sbox_2)
box_morph_2 = BoxMorph(Geometry=mesh_5, Reference=bounding_box_2.Box, Target=twisted_box_2)
box_morph_3 = BoxMorph(Geometry=mesh_7, Reference=bounding_box_3.Box, Target=twisted_box)
number_slider_2 = Slider(1, range=0..2)
mesh_join = MeshJoin(Meshes=box_morph)
weaverbird_s_join_meshes_and_weld = WeaverbirdsJoinMeshesAndWeld(Mesh=mesh_join, Weld=True)
weaverbird_s_catmull_clark_subdivision = WeaverbirdsCatmullClarkSubdivision(MeshCurves=weaverbird_s_join_meshes_and_weld, Level=number_slider_2, SmoothNakedEdges=2)
number_slider_3 = Slider(2.5, range=0..20)
weaverbird_s_catmull_clark_subdivision_2 = WeaverbirdsCatmullClarkSubdivision(MeshCurves=box_morph_2, Level=Slider(1, range=0..2), SmoothNakedEdges=2)
weaverbird_s_catmull_clark_subdivision_3 = WeaverbirdsCatmullClarkSubdivision(MeshCurves=box_morph_3, Level=Slider(1, range=0..2), SmoothNakedEdges=2)
weaverbird_s_mesh_thicken = WeaverbirdsMeshThicken(MeshCurves=weaverbird_s_catmull_clark_subdivision, Distance=Slider(4, range=1..5), OffsetType=0)
weaverbird_s_catmull_clark_subdivision_4 = WeaverbirdsCatmullClarkSubdivision(MeshCurves=weaverbird_s_mesh_thicken, Level=number_slider_2, SmoothNakedEdges=2)
weaverbird_s_mesh_thicken_2 = WeaverbirdsMeshThicken(MeshCurves=weaverbird_s_catmull_clark_subdivision_3, Distance=number_slider_3, OffsetType=0)
weaverbird_s_mesh_thicken_3 = WeaverbirdsMeshThicken(MeshCurves=weaverbird_s_catmull_clark_subdivision_2, Distance=number_slider_3, OffsetType=0)
merge = Merge(Data1=weaverbird_s_catmull_clark_subdivision_4, Data2=weaverbird_s_mesh_thicken_2, Data3=weaverbird_s_mesh_thicken_3)

# ---- group: preview
mesh_8 = Mesh(weaverbird_s_catmull_clark_subdivision_4)
mesh_9 = Mesh(weaverbird_s_mesh_thicken_2)
mesh_10 = Mesh(weaverbird_s_mesh_thicken_3)
mesh_colours_4 = MeshColours(Mesh=mesh_8, Colours=ColourSwatch(SwatchColor=RGB(255, 255, 255)))
mesh_colours_5 = MeshColours(Mesh=mesh_9, Colours=ColourSwatch(SwatchColor=RGB(255, 255, 255)))
mesh_colours_6 = MeshColours(Mesh=mesh_10, Colours=ColourSwatch(SwatchColor=RGB(255, 255, 255)))

# ---- group: final geometry
mesh_11 = Mesh(merge)
