# Grasshopper definition 3D.gh (Grasshopper 1.0.7)
# plug-ins: Weaverbird

# ---- group: input / horizontal division
number_slider = Slider(40, range=1..100)

# ---- group: input / box height
number_slider_2 = Slider(10, range=1..10)

# ---- group: input / vertical division
number_slider_3 = Slider(18, range=15..30)

# ---- group: input / cleaned outlines from base mesh
curve = Curve([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])

# ---- group: initial division
divide_curve = DivideCurve(Curve=curve, Count=number_slider, Kinks=False)  # -> Points, Tangents, Parameters
point = Point(simplify(divide_curve.Points))
flip_matrix = FlipMatrix(Data=point)
multiplication = Multiplication(A=number_slider_3, B="6")
interpolate = Interpolate(Vertices=flip_matrix, Degree=3, Periodic=True, KnotStyle=1)  # -> flatten(Curve), Length, Domain
divide_curve_2 = DivideCurve(Curve=interpolate.Curve, Count=multiplication, Kinks=False)  # -> simplify(Points), Tangents, Parameters
flip_matrix_2 = FlipMatrix(Data=divide_curve_2.Points)
interpolate_2 = Interpolate(Vertices=flip_matrix_2, Degree=3, Periodic=False, KnotStyle=1)  # -> flatten(Curve), Length, Domain

# ---- group: initial division / cleaning nulls
curve_2 = Curve(interpolate.Curve)
null_item = NullItem(Item=curve_2)  # -> NullFlags, InvalidFlags, Description
replace_nulls = ReplaceNulls(Items=curve_2, Replacements="-1")  # -> Items, Count
addition = Addition(A=replace_nulls.Items, B="1")

# ----
number = Number(number_slider_2)
number_2 = Number(number_slider_2)
number_3 = Number(number_slider_2)
number_4 = Number(number_slider_2)

# ---- group: applying compnents to surface / applying components to boxes / component
mesh = Mesh(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)

# ---- group: applying compnents to surface / adding subdivisions / thicnkess
number_slider_4 = Slider(10, range=0..10)

# ---- group: division no 4
cull_pattern = CullPattern(List=curve_2, CullPattern=addition)
curve_3 = Curve(interpolate_2.Curve)
shift_list = ShiftList(List=cull_pattern, Shift="2", Wrap=True)
panel = Panel("""1
0
0
1""")
cull_pattern_2 = CullPattern(List=shift_list, CullPattern=panel)
panel_2 = Panel("""-2
-1""")
panel_3 = Panel("""1
0
0
0
0
1""")
cull_pattern_3 = CullPattern(List=curve_3, CullPattern=panel_3)
cull_index = CullIndex(List=cull_pattern_2, Indices=panel_2, Wrap=True)  # -> simplify(flatten(List))
curve_4 = Curve(cull_index)
tree_statistics = TreeStatistics(Tree=cull_pattern_3)  # -> Paths, Length, Count

# ----
curve_5 = Curve(cull_pattern_3)

# ---- group: division no 4 (continued)
merge = Merge(Data1=curve_4, Data2=curve_5)  # -> flatten(Result)
multiple_curves = MultipleCurves(Curves=merge)  # -> Points, IndexA, IndexB, ParamA, ParamB
point_2 = Point(multiple_curves.Points)
partition_list = PartitionList(List=point_2, Size=tree_statistics.Length)  # -> simplify(Chunks)
point_3 = Point(simplify(partition_list))
partition_list_2 = PartitionList(List=point_3, Size="2")
path_mapper = PathMapper(partition_list_2, source="{A;B}", target="{B}")
partition_list_3 = PartitionList(List=path_mapper, Size="4")
point_4 = Point(partition_list_3)
list_item = ListItem(List=point_4, Index=0, Wrap=True)  # -> Item, Item1, Item2, Item3
_4point_surface = _4PointSurface(CornerA=list_item.Item, CornerB=list_item.Item1, CornerC=list_item.Item3, CornerD=list_item.Item2)  # -> reparameterize(Surface)
evaluate_surface = EvaluateSurface(Surface=_4point_surface, Point="0.5,0.5")  # -> Point, Normal, UDirection, VDirection, Frame
amplitude = Amplitude(Vector=evaluate_surface.Normal, Amplitude=number_2)
negative = Negative(Value=amplitude)
extrude = Extrude(Base=_4point_surface, Direction=negative)  # -> flatten(Extrusion)
deconstruct_brep = DeconstructBrep(Brep=extrude)  # -> Faces, Edges, Vertices
list_item_2 = ListItem(List=deconstruct_brep.Vertices, Index=0, Wrap=True)  # -> Item, Item1, Item2, Item3, Item4, Item5, Item6, Item7
twisted_box = TwistedBox(
    CornerA=list_item_2.Item,
    CornerB=list_item_2.Item1,
    CornerC=list_item_2.Item2,
    CornerD=list_item_2.Item3,
    CornerE=list_item_2.Item4,
    CornerF=list_item_2.Item5,
    CornerG=list_item_2.Item6,
    CornerH=list_item_2.Item7)
twisted_box_2 = TwistedBox(twisted_box)

# ---- group: division no 2
cull_pattern_4 = CullPattern(List=curve_2, CullPattern=addition)
curve_6 = Curve(interpolate_2.Curve)
panel_4 = Panel("""1
0
0
1""")
shift_list_2 = ShiftList(List=cull_pattern_4, Shift="3", Wrap=True)
shift_list_3 = ShiftList(List=curve_6, Shift="3", Wrap=True)
cull_pattern_5 = CullPattern(List=shift_list_2, CullPattern=panel_4)
panel_5 = Panel("""1
0
0
0
0
1""")
cull_pattern_6 = CullPattern(List=shift_list_3, CullPattern=panel_5)
curve_7 = Curve(cull_pattern_5)
panel_6 = Panel("""-2
-1""")
cull_index_2 = CullIndex(List=curve_7, Indices=panel_6, Wrap=True)  # -> flatten(List)
tree_statistics_2 = TreeStatistics(Tree=cull_pattern_6)  # -> Paths, Length, Count

# ----
curve_8 = Curve(cull_index_2)
curve_9 = Curve(cull_pattern_6)

# ---- group: division no 2 (continued)
merge_2 = Merge(Data1=curve_8, Data2=curve_9)  # -> flatten(Result)
multiple_curves_2 = MultipleCurves(Curves=merge_2)  # -> Points, IndexA, IndexB, ParamA, ParamB
point_5 = Point(multiple_curves_2.Points)
partition_list_4 = PartitionList(List=point_5, Size=tree_statistics_2.Length)  # -> simplify(Chunks)
point_6 = Point(simplify(partition_list_4))
partition_list_5 = PartitionList(List=point_6, Size="2")
path_mapper_2 = PathMapper(partition_list_5, source="{A;B}", target="{B}")
partition_list_6 = PartitionList(List=path_mapper_2, Size="4")
point_7 = Point(partition_list_6)
list_item_3 = ListItem(List=point_7, Index=0, Wrap=True)  # -> Item, Item1, Item2, Item3
_4point_surface_2 = _4PointSurface(CornerA=list_item_3.Item, CornerB=list_item_3.Item1, CornerC=list_item_3.Item3, CornerD=list_item_3.Item2)  # -> reparameterize(Surface)
evaluate_surface_2 = EvaluateSurface(Surface=_4point_surface_2, Point="0.5,0.5")  # -> Point, Normal, UDirection, VDirection, Frame
amplitude_2 = Amplitude(Vector=evaluate_surface_2.Normal, Amplitude=number_4)
negative_2 = Negative(Value=amplitude_2)
extrude_2 = Extrude(Base=_4point_surface_2, Direction=negative_2)  # -> flatten(Extrusion)
deconstruct_brep_2 = DeconstructBrep(Brep=extrude_2)  # -> Faces, Edges, Vertices
list_item_4 = ListItem(List=deconstruct_brep_2.Vertices, Index=0, Wrap=True)  # -> Item, Item1, Item2, Item3, Item4, Item5, Item6, Item7
twisted_box_3 = TwistedBox(
    CornerA=list_item_4.Item,
    CornerB=list_item_4.Item1,
    CornerC=list_item_4.Item2,
    CornerD=list_item_4.Item3,
    CornerE=list_item_4.Item4,
    CornerF=list_item_4.Item5,
    CornerG=list_item_4.Item6,
    CornerH=list_item_4.Item7)
twisted_box_4 = TwistedBox(twisted_box_3)

# ---- group: division no 3
curve_10 = Curve(interpolate_2.Curve)
cull_pattern_7 = CullPattern(List=curve_2, CullPattern=addition)
panel_7 = Panel("""1
0
0
1""")
panel_8 = Panel("""1
0
0
0
0
1""")
cull_pattern_8 = CullPattern(List=cull_pattern_7, CullPattern=panel_7)
cull_pattern_9 = CullPattern(List=curve_10, CullPattern=panel_8)
curve_11 = Curve(cull_pattern_8)
tree_statistics_3 = TreeStatistics(Tree=cull_pattern_9)  # -> Paths, Length, Count

# ----
curve_12 = Curve(cull_pattern_9)

# ---- group: division no 3 (continued)
merge_3 = Merge(Data1=curve_11, Data2=curve_12)  # -> flatten(Result)
multiple_curves_3 = MultipleCurves(Curves=merge_3)  # -> Points, IndexA, IndexB, ParamA, ParamB
point_8 = Point(multiple_curves_3.Points)
partition_list_7 = PartitionList(List=point_8, Size=tree_statistics_3.Length)  # -> simplify(Chunks)
point_9 = Point(simplify(partition_list_7))
partition_list_8 = PartitionList(List=point_9, Size="2")
path_mapper_3 = PathMapper(partition_list_8, source="{A;B}", target="{B}")
partition_list_9 = PartitionList(List=path_mapper_3, Size="4")
point_10 = Point(partition_list_9)
list_item_5 = ListItem(List=point_10, Index=0, Wrap=True)  # -> Item, Item1, Item2, Item3
_4point_surface_3 = _4PointSurface(CornerA=list_item_5.Item, CornerB=list_item_5.Item1, CornerC=list_item_5.Item3, CornerD=list_item_5.Item2)  # -> reparameterize(Surface)
evaluate_surface_3 = EvaluateSurface(Surface=_4point_surface_3, Point="0.5,0.5")  # -> Point, Normal, UDirection, VDirection, Frame
amplitude_3 = Amplitude(Vector=evaluate_surface_3.Normal, Amplitude=number)
negative_3 = Negative(Value=amplitude_3)
extrude_3 = Extrude(Base=_4point_surface_3, Direction=negative_3)  # -> flatten(Extrusion)
deconstruct_brep_3 = DeconstructBrep(Brep=extrude_3)  # -> Faces, Edges, Vertices
list_item_6 = ListItem(List=deconstruct_brep_3.Vertices, Index=0, Wrap=True)  # -> Item, Item1, Item2, Item3, Item4, Item5, Item6, Item7
twisted_box_5 = TwistedBox(
    CornerA=list_item_6.Item,
    CornerB=list_item_6.Item1,
    CornerC=list_item_6.Item2,
    CornerD=list_item_6.Item3,
    CornerE=list_item_6.Item4,
    CornerF=list_item_6.Item5,
    CornerG=list_item_6.Item6,
    CornerH=list_item_6.Item7)
twisted_box_6 = TwistedBox(twisted_box_5)

# ---- group: division no 1
cull_pattern_10 = CullPattern(List=curve_2, CullPattern=addition)
curve_13 = Curve(interpolate_2.Curve)
shift_list_4 = ShiftList(List=cull_pattern_10, Shift="1", Wrap=True)
shift_list_5 = ShiftList(List=curve_13, Shift="3", Wrap=True)
panel_9 = Panel("""1
0
0
1""")
cull_pattern_11 = CullPattern(List=shift_list_4, CullPattern=panel_9)
panel_10 = Panel("""-2
-1""")
panel_11 = Panel("""1
0
0
0
0
1""")
curve_14 = Curve(cull_pattern_11)
cull_index_3 = CullIndex(List=curve_14, Indices=panel_10, Wrap=True)  # -> flatten(List)
cull_pattern_12 = CullPattern(List=shift_list_5, CullPattern=panel_11)
tree_statistics_4 = TreeStatistics(Tree=cull_pattern_12)  # -> Paths, Length, Count

# ----
curve_15 = Curve(cull_index_3)
curve_16 = Curve(cull_pattern_12)

# ---- group: division no 1 (continued)
merge_4 = Merge(Data1=curve_15, Data2=curve_16)  # -> flatten(Result)
multiple_curves_4 = MultipleCurves(Curves=merge_4)  # -> Points, IndexA, IndexB, ParamA, ParamB
point_11 = Point(multiple_curves_4.Points)
partition_list_10 = PartitionList(List=point_11, Size=tree_statistics_4.Length)  # -> simplify(Chunks)
point_12 = Point(simplify(partition_list_10))
partition_list_11 = PartitionList(List=point_12, Size="2")
path_mapper_4 = PathMapper(partition_list_11, source="{A;B}", target="{B}")
partition_list_12 = PartitionList(List=path_mapper_4, Size="4")
point_13 = Point(partition_list_12)
list_item_7 = ListItem(List=point_13, Index=0, Wrap=True)  # -> Item, Item1, Item2, Item3
_4point_surface_4 = _4PointSurface(CornerA=list_item_7.Item, CornerB=list_item_7.Item1, CornerC=list_item_7.Item3, CornerD=list_item_7.Item2)  # -> reparameterize(Surface)
evaluate_surface_4 = EvaluateSurface(Surface=_4point_surface_4, Point="0.5,0.5")  # -> Point, Normal, UDirection, VDirection, Frame
amplitude_4 = Amplitude(Vector=evaluate_surface_4.Normal, Amplitude=number_3)
negative_4 = Negative(Value=amplitude_4)
extrude_4 = Extrude(Base=_4point_surface_4, Direction=negative_4)  # -> flatten(Extrusion)
deconstruct_brep_4 = DeconstructBrep(Brep=extrude_4)  # -> Faces, Edges, Vertices
list_item_8 = ListItem(List=deconstruct_brep_4.Vertices, Index=0, Wrap=True)  # -> Item, Item1, Item2, Item3, Item4, Item5, Item6, Item7
twisted_box_7 = TwistedBox(
    CornerA=list_item_8.Item,
    CornerB=list_item_8.Item1,
    CornerC=list_item_8.Item2,
    CornerD=list_item_8.Item3,
    CornerE=list_item_8.Item4,
    CornerF=list_item_8.Item5,
    CornerG=list_item_8.Item6,
    CornerH=list_item_8.Item7)
twisted_box_8 = TwistedBox(twisted_box_7)

# ---- group: applying compnents to surface / applying components to boxes
merge_5 = Merge(Data1=twisted_box_8, Data2=twisted_box_4, Data3=twisted_box_6, Data4=twisted_box_2)
mesh_2 = Mesh(mesh)
bbox = BoundingBox(Content=mesh_2, Plane=PlaneXY(0, 0, 0))  # -> Box, Box_2
morph = BoxMorph(Geometry=mesh_2, Reference=bbox.Box, Target=merge_5)

# ---- group: applying compnents to surface / deleting invalid meshes
match_text = MatchText(Text=morph, Pattern="Invalid Mesh", Case=True)
addition_2 = Addition(A=match_text, B="1")
replace_text = ReplaceText(Text=addition_2, Find="2", Replace="0", RecursiveReplace=False)
cull_pattern_13 = CullPattern(List=morph, CullPattern=replace_text)

# ---- group: applying compnents to surface / adding subdivisions
number_slider_5 = Slider(2, range=0..2)
wbcatmullclark = WeaverbirdsCatmullClarkSubdivision(MeshCurves=cull_pattern_13, Level=number_slider_5, SmoothNakedEdges=2)
mesh_3 = Mesh(flatten(wbcatmullclark))
cull_index_4 = CullIndex(List=mesh_3, Indices="-1", Wrap=True)
wbthicken = WeaverbirdsMeshThicken(MeshCurves=cull_index_4, Distance=number_slider_4, OffsetType=0)
wbcatmullclark_2 = WeaverbirdsCatmullClarkSubdivision(MeshCurves=wbthicken, Level=number_slider_5, SmoothNakedEdges=2)

# ---- group: preview
mesh_4 = Mesh(wbcatmullclark_2)
custom_preview = CustomPreview(Geometry=mesh_4, Material=ColourSwatch(SwatchColor=RGB(158, 136, 136)))

# ---- group: final geometry
mesh_5 = Mesh(wbcatmullclark_2)
